# Dynamo graph Quick View Placement.dyn (Dynamo 2.6.1.8786)
# packages: spring nodes 204.1.0, Rhythm 2020.9.8

byCoordinates = Point.ByCoordinates()

# group: Quick Place View on Sheet
# note: Custom Node: spring nodes v.204.1.0
ꟿ_collect_currentselection = Custom[ꟿ Collect.CurrentSelection]()  # package spring nodes; Gets the currently selected elements. Connect a boolean switch to refresh the selection.
ꟿ_collect_currentselection_2 = Custom[ꟿ Collect.CurrentSelection]()
# note: Custom Node: Rhythm v.2020.9.8
ʳʰʸᵗʰᵐ_viewport_create = Rhythm.Revit.Elements.Viewport.Create(sheet=ꟿ_collect_currentselection, view=ꟿ_collect_currentselection_2, location=byCoordinates)
