# Dynamo graph VIEW - Apply View Templates.dyn "000 - Apply View Templates" (Dynamo 2.1.0.7500)

code_block = CodeBlock { "Select View Templates to apply"; }
getViewTemplates = Synthetic.Revit.ViewTemplate.GetViewTemplates()
code_block_2 = CodeBlock { false; }
# note: Package:  Data-Shapes
ui_listview_data = Custom[UI.Listview Data](InputName=code_block, Keys=getViewTemplates.template_names, Values=getViewTemplates.templates, SortItems_optionnal=code_block_2)  # Create data for ListView input in UI.MultiInputForm ++ . Check out www.data-shapes.net for more infos.
code_block_3 = CodeBlock { "Select Views"; }
# note: Package:  Bakery
get_all_views = Custom[Get All Views]()  # taken from archi-lab
list_create = List.Create(item0=get_all_views.Engineering_Plans, item1=get_all_views.3D_Views, item2=get_all_views.Floor_Plans, item3=get_all_views.Sections)
flatten = List.Flatten(list=list_create)
code_block_4 = CodeBlock(Element=flatten) { Element.Name; }
ui_listview_data_2 = Custom[UI.Listview Data](InputName=code_block_3, Keys=code_block_4, Values=flatten, SortItems_optionnal=code_block_2)
create = List.Create(item0=ui_listview_data, item1=ui_listview_data_2)

# group: RESET
boolean = BoolSelector(true)

# group: Creates a UI
code_block_5 = CodeBlock { "Apply View Templates"; }
code_block_6 = CodeBlock { "Run"; }
code_block_7 = CodeBlock { "Cancel"; }
code_block_8 = CodeBlock { 700; }
ui_multipleinputform = Custom[UI.MultipleInputForm ++](Description_optional=code_block_5, ButtonText_optional=code_block_6, Inputs=create, Toggle=boolean, CancelButtonText_optional=code_block_7, MaxHeight_optional=code_block_8, Width_optional=code_block_8)  # Create a form with multiple inputs. see www.data-shapes.net for tutorials and infos!

# group: Router for input data from UI
code_block_9 = CodeBlock(viewtemp=ui_multipleinputform.User_Inputs, views=ui_multipleinputform.User_Inputs) { viewtemp[0]; views[1]; }

code_block_10 = CodeBlock(Element=code_block_9.out0) { Element.Name; }
# note: Package:  Steamnodes
# Lacing:  Longest
applyViewTemplate = Custom[View.ApplyViewTemplate](Views=code_block_9.out1, View_Template_Name=code_block_10, lacing=Longest)  # Applies a view template to any given view(s). Supply a string with a view template name.
