# Dynamo graph VIEW - Place Views on Sheets by View Name.dyn (Dynamo 2.12.1.8246)
# packages: Data-Shapes 2023.2.112, archi-lab.net 2024.217.1024, MEPover 2022.10.30, Clockwork for Dynamo 1.x 1.0.3

code_block = CodeBlock { "Scale Views down before running or they won't fit on Sheets.  Make sure that input Views are not empty, as this sometimes causes an error."; }
# note: Package:  Data-Shapes
ui_textnote_data = Custom[UI.TextNote Data](TextNote=code_block)  # package Data-Shapes; Create Data for TextNote input in UI.MultipleInputForm ++ . Check out www.data-shapes.net for more informations

# group: 0
code_block_2 = CodeBlock { "Titleblock Family"; }
code_block_3 = CodeBlock { "Title Blocks"; }
byName = Category.ByName(name=code_block_3)
code_block_4 = CodeBlock { 0; }

all_families_of_category = Custom[All Families Of Category](category=byName)  # package Clockwork for Dynamo 1.x; Gets all famiies of a given category in the model (does *not *work for system families)
family_types_of_family = Custom[Family types of family](family=all_families_of_category)  # package MEPover; Returns every family type of the given Family
flatten = List.Flatten(list=family_types_of_family)

# group (continued): 0
name = FamilyType.Name(familyType=flatten)

ui_dropdown_data = Custom[UI.DropDown Data](InputName=code_block_2, Keys=name, Values=flatten, DefaultValueIndex=code_block_4)  # package Data-Shapes; Create data for DropDown input in UI.MultiInputForm ++ . Check out www.data-shapes.net for more infos.
code_block_5 = CodeBlock { "Sheet number must be unique."; }
ui_textnote_data_2 = Custom[UI.TextNote Data](TextNote=code_block_5)

# group: 1
code_block_6 = CodeBlock { "Starting Sheet Number"; }
code_block_7 = CodeBlock { "0"; }
ui_textbox_data = Custom[UI.TextBox Data](InputName=code_block_6, DefaultText=code_block_7)  # package Data-Shapes; Create Data for TextBox input in UI.MultipleInputForm ++ . Check out www.data-shapes.net for more informations

code_block_8 = CodeBlock { "Select the Views to be Placed.  Make sure the View you are placing isn't already on a Sheet.  If you want to include 3D Views, make sure you select an amount matching your selected number of Floor Plans.  Floor Plan View Names are used to automatically generate Sheet Names"; }
ui_textnote_data_3 = Custom[UI.TextNote Data](TextNote=code_block_8)
code_block_9 = CodeBlock { "3D Views"; }
code_block_10 = CodeBlock { "3D"; }
# note: Package:  archilab
getByType = archilab.Revit.Views.Views.GetByType(viewType=code_block_10)
name_2 = Element.Name(element=getByType)
code_block_11 = CodeBlock { false; }
ui_listview_data = Custom[UI.Listview Data](InputName=code_block_9, Keys=name_2, Values=getByType, SortItems_optionnal=code_block_11)  # package Data-Shapes; Create data for ListView input in UI.MultiInputForm ++ . Check out www.data-shapes.net for more infos.
code_block_12 = CodeBlock { "Number of Views per Sheet"; }
code_block_13 = CodeBlock { "4"; }
ui_textbox_data_2 = Custom[UI.TextBox Data](InputName=code_block_12, DefaultText=code_block_13)
create = List.Create(item0=ui_textnote_data, item1=ui_dropdown_data, item2=ui_textnote_data_2, item3=ui_textbox_data, item4=ui_textnote_data_3, item5=ui_listview_data, item6=ui_textbox_data_2)

# group: RESET
boolean = BoolSelector(true)  # graph input

# group: Creates a UI
code_block_14 = CodeBlock { "Place Views on Sheets"; }
code_block_15 = CodeBlock { "Run"; }
code_block_16 = CodeBlock { "https://data-shapes.net/"; }
code_block_17 = CodeBlock { "Cancel"; }
code_block_18 = CodeBlock { 800; }
ui_multipleinputform = Custom[UI.MultipleInputForm ++](Description_optional=code_block_14, ButtonText_optional=code_block_15, Inputs=create, Toggle=boolean, LinkToHelp_optional=code_block_16, CancelButtonText_optional=code_block_17, MaxHeight_optional=code_block_18)  # package Data-Shapes; Create a form with multiple inputs. see www.data-shapes.net for tutorials and infos!

# group: Router for input data from UI
code_block_19 = CodeBlock(titleblock=ui_multipleinputform.User_Inputs, startnumber=ui_multipleinputform.User_Inputs, threeds=ui_multipleinputform.User_Inputs, viewsper=ui_multipleinputform.User_Inputs) { titleblock[0]; startnumber[1]; threeds[2]; viewsper[3]; }

# note: Package: Orchid
sortNatural = Orchid.Core.List.SortNatural(list=code_block_19.out2)
name_3 = Element.Name(element=sortNatural)

# group: Creates Sheet Numbers
toNumber = String.ToNumber(string=code_block_19.out1)
count = List.Count(list=sortNatural)
code_block_20 = CodeBlock { 1; }
sequence = Sequence(start=toNumber, amount=count, step=code_block_20, lacing=Longest)
string_from_object = FromObject(obj=sequence)

clear_list = Custom[Clear List](input=sortNatural)  # package archi-lab.net; This node will remove all Null and Empty Lists from any list.
transpose = List.Transpose(lists=clear_list)
toNumber_2 = String.ToNumber(string=code_block_19.out3)
chop = List.Chop(list=transpose, lengths=toNumber_2)

# group: View size cannot exceed sheet size. A word of advice: Set your view scales en masse, from the Project Browser, before running. Lacing: Longest
byNameNumberTitleBlockAndViews = Sheet.ByNameNumberTitleBlockAndViews(sheetName=name_3, sheetNumber=string_from_object, titleBlockFamilyType=code_block_19.out0, views=chop, lacing=Longest)

boolean_2 = BoolSelector(true)  # graph input
